# Grasshopper definition test.gh (Grasshopper 1.0.7)
# plug-ins: MyGrasshopperPlugIn

number_slider = Slider(3, range=1..10)
number_slider_2 = Slider(5, range=1..10)
multiplication = Multiplication(A=number_slider, B=number_slider_2)
series = Series(Start=0, Step=1, Count=multiplication)
test = TestPython(TextToLower="HELLO", TextToUpper="from python")
startpy = StartPythonComponent(
    StartPython=Toggle(True),
    UserMode="false",
    Level=30000,
    TimeOut=10,
    CondaEnvironmentName="base",
    AnacondaDirectory="C:\Users\Jonas\Anaconda3")
panel = Panel(series)
panel_2 = Panel(test)
executepython = APythonConnectedComponent(AListOfNumbers=panel, RowNumber=number_slider, ColumnsNumber=number_slider_2)
viewer = ParamViewer(executepython)
panel_3 = Panel(executepython)
